# Grasshopper definition 20210808_PathFinding_Kangaroo.gh (Grasshopper 1.0.7)
# plug-ins: Kangaroo2 Components

number_slider = Slider(1, range=0..1)
number_slider_2 = Slider(20, range=0..100)
number_slider_3 = Slider(20, range=0..100)
# INPUTS
pt = Point(<point referenced from the Rhino model>)
pt_2 = Point(<point referenced from the Rhino model>)

merge = Merge(Data1=pt, Data2=pt_2)
ln = Line(StartPoint=pt, EndPoint=pt_2)
sqgrid = Square(Plane=PlaneXY(0, 0, 0), Size=number_slider, ExtentX=number_slider_2, ExtentY=number_slider_3)  # -> Cells, Points
pt_3 = Point(flatten(sqgrid.Points))

# ----
# A. CREATING OBSTACLES
number_slider_4 = Slider(0.35, range=0..1)
multiplication = Multiplication(A=number_slider_2, B=number_slider_3)
multiplication_2 = Multiplication(A=multiplication, B=number_slider_4)
int = Integer(multiplication_2)
reduce = RandomReduce(List=pt_3, Reduction=int, Seed=Slider(25, range=0..100))

# ----
# OBSTACLES
number_slider_5 = Slider(0.27, range=0..10)
cir = Circle(Plane=reduce, Radius=number_slider_5)

crv_cp = CurveClosestPoint(Point=reduce, Curve=reparameterize(ln))  # -> Point, Parameter, Distance
# B. CLOSEST OBSTACLE POINTS TO THE DESTINATION LINE
len = Length(Curve=ln)
multiplication_3 = Multiplication(A=len, B=Slider(0.01, range=0..0.1))
smaller = SmallerThan(FirstNumber=crv_cp.Distance, SecondNumber=multiplication_3)  # -> SmallerThan, OrEqualTo
dispatch = Dispatch(List=crv_cp.Parameter, DispatchPattern=smaller.SmallerThan)  # -> ListA, ListB
num = Number(dispatch.ListA)
sort = SortList(Keys=num)  # -> Keys, ValuesA

# ----
# C. ADDING MORE POINTS FOR SIMULATION
len_2 = Length(Curve=ln)
multiplication_4 = Multiplication(A=Slider(0.2, range=0..1), B=number_slider)
division = Division(A=multiplication_4, B=len_2)
addition = Addition(A=sort.Keys, B=division)
subtraction = Subtraction(A=sort.Keys, B=division)
panel = Panel("""0
1
2""")
weave = Weave(Pattern=panel, Stream0=subtraction, Stream1=sort.Keys, Stream2=addition, NullGaps=False)
merge_2 = Merge(Data1=flatten("0"), Data2=flatten(weave), Data3=flatten("1"))
eval = EvaluateCurve(Curve=reparameterize(ln), Parameter=merge_2)  # -> Point, Tangent, Angle

merge_3 = Merge(Data1=reduce, Data2=eval.Point)  # -> flatten(Result)
collider = Collider(Objects=merge_3, Radii=Slider(0.35, range=0..1), Strength=Slider(357, range=0..1000))

# ----
# D. SIMULATIO GOALS
toggle = BooleanToggle(True)
anchorxyz = AnchorXYZ(Point=merge, X=toggle, Y=toggle, Z=toggle, Strength=1000)

merge_4 = Merge(Data1=simplify(collider), Data2=simplify(anchorxyz))
bouncysolver = BouncySolver(
    GoalObjects=merge_4,
    Reset=Button(),
    Threshold=1e-15,
    Tolerance=0.01,
    Damping=Slider(0.18, range=0..1),
    Iterations=10,
    On=Toggle(True))  # -> I, V, O

# ----
# E. EXTRACTING PATH POINTS
number_slider_6 = Slider(1, range=0..10)
lng = ListLength(List=eval.Point)
pt_4 = Point(bouncysolver.V)
subtraction_2 = Subtraction(A=lng, B=number_slider_6)
dom = ConstructDomain(DomainStart="0", DomainEnd=subtraction_2)
subset = SubList(List=pt_4, Domain=dom, Wrap=True)  # -> List, Index

# ----
# PATH
nurbs = NurbsCurve(Vertices=subset.List, Degree=3, Periodic=False)  # -> Curve, Length, Domain
